# Grasshopper definition 20190503_bouzai.gh (Grasshopper 1.0.7)
# plug-ins: V-Ray For Grasshopper 6

number_slider = Slider(12, range=0..30)

# ---- group: Size of stick
width_height = DigitScroller(Scroller_Digits=12, Scroller_Prefix="width&height", Scroller_Radix=11, Scroller_Value=3)
length = DigitScroller(Scroller_Digits=12, Scroller_Prefix="length", Scroller_Radix=11, Scroller_Value=900)

# ----
number_slider_2 = Slider(450, range=0..1000)
multiplication = Multiplication(A=Slider(180, range=0..180), B="-1")
panel = Panel(Slider(180, range=0..180))
panel_2 = Panel(multiplication)
subtraction = Subtraction(A=panel, B=panel_2)
division = Division(A=subtraction, B=number_slider)
subtraction_2 = Subtraction(A=number_slider_2, B=Slider(0, range=0..1000))
vec = VectorXYZ(XComponent=width_height, YComponent=0, ZComponent=0)  # -> Vector, Length
rectangle = Rectangle(Plane=PlaneXY(0, 0, 0), XSize=width_height, YSize=width_height, Radius=0)  # -> Rectangle, Length
series = Series(Start=0, Step=width_height, Count=division)
division_2 = Division(A=subtraction_2, B=division)
addition = Addition(A=division, B=Slider(0, range=0..1))

# ---- group: Rotate Components / Calc rotate angle lists
subtraction_3 = Subtraction(A=panel, B=panel_2)
division_3 = Division(A=subtraction_3, B=number_slider)
series_2 = Series(Start=panel_2, Step=number_slider, Count=addition)

# ----
pt = ConstructPoint(XCoordinate=series, YCoordinate=0, ZCoordinate=0)
multiplication_2 = Multiplication(A=division_2, B="-1")
series_3 = Series(Start=number_slider_2, Step=multiplication_2, Count=addition)
boxrec = BoxRectangle(Rectangle=rectangle.Rectangle, Height=series_3)

# ---- group: Rotate Components / Calc the rotate angle as radian
pi = Pi(Factor=1)
division_4 = Division(A=series_2, B="180")
multiplication_3 = Multiplication(A=pi, B=division_4)

# ----
addition_2 = Addition(A=pt, B=vec.Vector)
multiplication_4 = Multiplication(A=addition_2, B="2")
pdecon = Deconstruct(Point=multiplication_4)  # -> XComponent, YComponent, ZComponent
move = Move(Geometry=boxrec, Motion=pt)  # -> Geometry, Transform

# ---- group: Rotate Components
yz = YZPlane(Origin=Point(0, 0, 0))
rotate = Rotate(Geometry=move.Geometry, Angle=multiplication_3, Plane=yz)  # -> Geometry, Transform

# ----
boxrec_2 = BoxRectangle(Rectangle=rectangle.Rectangle, Height=multiplication_4)
mirror = Mirror(Geometry=rotate.Geometry, Plane=PlaneYZ(0, 0, 0))  # -> Geometry, Transform
multiplication_5 = Multiplication(A=multiplication_4, B=Slider(0.5, range=0..1), C="-1")
pdecon_2 = Deconstruct(Point=multiplication_5)  # -> XComponent, YComponent, ZComponent
vec_2 = VectorXYZ(XComponent=0, YComponent=0, ZComponent=pdecon_2.XComponent)  # -> Vector, Length
move_2 = Move(Geometry=boxrec_2, Motion=vec_2.Vector)  # -> Geometry, Transform
geo = Geometry([mirror.Geometry, rotate.Geometry])
xz = XZPlane(Origin=Point(0, 0, 0))
panel_3 = Panel(series_3)
vec_3 = VectorXYZ(
    XComponent=Slider(-1000, range=-10000..10000),
    YComponent=Slider(1000, range=-10000..10000),
    ZComponent=Slider(-1500, range=-10000..10000))  # -> Vector, Length
rotate_2 = Rotate(Geometry=move_2.Geometry, Angle=1.570796327, Plane=xz)  # -> Geometry, Transform
vec_4 = VectorXYZ(XComponent=0, YComponent=0, ZComponent=0)  # -> Vector, Length
vec_5 = VectorXYZ(XComponent=0, YComponent=0, ZComponent=series_3)  # -> Vector, Length
hsv = ColourHSV(Alpha=1, Hue=Slider(0.081, range=0..1), Saturation=Slider(0.8, range=0..1), Value=Slider(0.6, range=0..1))
mtl_simple = VRayMaterialSimple(
    Diffuse=ColourSwatch(SwatchColor=RGB(94, 94, 94)),
    Reflection=RGB(137, 137, 137),
    Glossiness=0.85,
    IOR=1.3,
    Opacity=1,
    Emission=RGB(0, 0, 0))
move_3 = Move(Geometry=rotate_2.Geometry, Motion=vec_5.Vector)  # -> Geometry, Transform
rotate_3 = Rotate(Geometry=move_3.Geometry, Angle=multiplication_3, Plane=yz)  # -> Geometry, Transform
panel_4 = Panel(pdecon.XComponent)

# ---- group: Result
geo_2 = Geometry([geo, rotate_3.Geometry])

# ----
material = CreateMaterial(
    Diffuse=hsv,
    Specular=RGB(255, 255, 255),
    Emission=RGB(0, 0, 0),
    Transparency=Slider(0, range=0..1),
    Shine=Slider(2, range=0..100))
camera = VRayCamera(
    Position=vec_3.Vector,
    Target=vec_4.Vector,
    FOV=50.586597,
    PhysicalExposureOn=False,
    FNumber=8,
    ShutterSpeed1S=100,
    FilmSensitivity=625)  # -> Camera, Angle
mesh = MeshBrep(
    Brep=geo_2,
    Settings={GridMaxCount=0, GridMinCount=16, JaggedSeams=False, MaxEdgeLength=0, MinEdgeLength=0.0001, MinTolerance=0, Refine=True, RefineAngle=0, RelativeTolerance=0.65, SimplePlanes=True, Tolerance=0})
vgeo = VRayGeometry(Geo=mesh, Material=mtl_simple)
panel_5 = Panel(series_2)

# ---- group: Rendering
preview = CustomPreview(Geometry=geo_2, Material=material)

# ----
engine = Engine(1, Has_Extract_Parameter=False, Has_Manage_Collection=False, OptionsLength=2, Options=["CPU", "GPU"])
mode = Mode(1, Has_Extract_Parameter=False, Has_Manage_Collection=False, OptionsLength=2, Options=["Interactive", "Production"])
sampler = Sampler(0, Has_Extract_Parameter=False, Has_Manage_Collection=False, OptionsLength=2, Options=["Progressive", "Bucket"])
panel_6 = Panel("""4000
4000""")
quality = Quality(
    4,
    Has_Extract_Parameter=False,
    Has_Manage_Collection=False,
    OptionsLength=5,
    Options=["Draft", "Low", "Medium", "High", "Very High"])
save_file = OutputImage(
    "\\Mac\Home\Desktop\20190503_stick003.png",
    File_Picker=1,
    File_Types="Portable Network Graphics (*.png)|*.png|Windows bitmap (*.bmp)|*.bmp|Targa Image (*.tga)|*.tga|Radiance High-Dynamyc Range (*.hdr)|*.hdr|Silicon Graphics (*.sgi; *.rgb; *.rgba)|*.dgi;*.rgb;*.rgba|JPEG image (*.jpg; *.jpeg)|*.jpg;*.jpeg|OpenEXR image (*.exr)|*.exr|SoftImage PICT (*.pic)|*.pic|Tagged image (*.tif; *.tiff)|*.tif;*.tiff|V-Ray Raw Image (*.vrimg)|*.vrimg",
    Has_Extract_Parameter=False,
    Has_Manage_Collection=True,
    Has_Multiple_Files_Menu=False,
    Has_Picker_File_Menu=False,
    Multiple_Files=False)
rad = Radians(Degrees=panel_5)
vec_6 = VectorXYZ(XComponent=0, YComponent=0, ZComponent=0)  # -> Vector, Length
multiplication_6 = Multiplication(A=width_height, B=Slider(2, range=0..10))
multiplication_7 = Multiplication(A=width_height, B=Slider(2, range=0..10))
multiplication_8 = Multiplication(A=width_height, B=Slider(2, range=0..10))
sin = Sine(Value=rad)
cos = Cosine(Value=rad)
vec_7 = VectorXYZ(XComponent=cos, YComponent=sin, ZComponent=0)  # -> Vector, Length
rectangle_2 = Rectangle(Plane=PlaneXY(0, 0, 0), XSize=panel_3, YSize=width_height, Radius=0)  # -> Rectangle, Length
rectangle_3 = Rectangle(Plane=PlaneXY(0, 0, 0), XSize=panel_3, YSize=width_height, Radius=0)  # -> Rectangle, Length
rectangle_4 = Rectangle(Plane=PlaneXY(0, 0, 0), XSize=panel_4, YSize=width_height, Radius=0)  # -> Rectangle, Length
lng = ListLength(List=rectangle_2.Rectangle)
series_4 = Series(Start=0, Step=multiplication_6, Count=lng)
lng_2 = ListLength(List=rectangle_3.Rectangle)
series_5 = Series(Start=0, Step=multiplication_7, Count=lng_2)
lng_3 = ListLength(List=rectangle_4.Rectangle)
series_6 = Series(Start=0, Step=multiplication_8, Count=lng_3)
addition_3 = Addition(A=series_5, B="3")
multiplication_9 = Multiplication(A=vec_7.Vector, B=Slider(100, range=0..1000))
multiplication_10 = Multiplication(A=Slider(300, range=0..1000), B="-1")
ln = Line(StartPoint=vec_6.Vector, EndPoint=multiplication_9)
pt_2 = ConstructPoint(XCoordinate=0, YCoordinate=series_4, ZCoordinate=0)
pt_3 = ConstructPoint(XCoordinate=0, YCoordinate=addition_3, ZCoordinate=0)
render = VRayRender(
    Engine=engine,
    Mode=mode,
    Sampler=sampler,
    Quality=quality,
    OutputImage=save_file,
    OutputResolution=panel_6,
    Camera=camera.Camera,
    VGeometry=flatten(vgeo))
pt_4 = ConstructPoint(XCoordinate=multiplication_10, YCoordinate=series_6, ZCoordinate=0)
move_4 = Move(Geometry=rectangle_2.Rectangle, Motion=pt_2)  # -> Geometry, Transform
move_5 = Move(Geometry=rectangle_3.Rectangle, Motion=pt_3)  # -> Geometry, Transform
move_6 = Move(Geometry=rectangle_4.Rectangle, Motion=pt_4)  # -> Geometry, Transform
panel_7 = Panel(move_4.Geometry)
panel_8 = Panel(move_5.Geometry)
panel_9 = Panel(move_6.Geometry)
geo_3 = Geometry(ln)
xz_2 = XZPlane(Origin=Point(0, 0, 0))
mirror_2 = Mirror(Geometry=move_5.Geometry, Plane=xz_2)  # -> Geometry, Transform
geo_4 = Geometry([move_6.Geometry, move_4.Geometry, mirror_2.Geometry])
